% Simulink data dictionary slprj_FM.sldd
% references sl_ddtypes.sldd

FM_CEngDsT_SRCHi_Fault_ID = Simulink.Parameter(10, StorageClass="Define", HeaderFile="FM_Fault_ID.h", DataType="Fault_ID", Min=0, Max=65535)
FM_CEngDsT_SRCLo_Fault_ID = Simulink.Parameter(11, StorageClass="Define", HeaderFile="FM_Fault_ID.h", DataType="Fault_ID", Min=0, Max=65535)
FM_CEngDsT_PRCHi_Fault_ID = Simulink.Parameter(12, StorageClass="Define", HeaderFile="FM_Fault_ID.h", DataType="Fault_ID", Min=0, Max=65535)
FM_CEngDsT_PRCLo_Fault_ID = Simulink.Parameter(13, StorageClass="Define", HeaderFile="FM_Fault_ID.h", DataType="Fault_ID", Min=0, Max=65535)
FM_Test1_Fault_ID = Simulink.Parameter(1, StorageClass="Define", HeaderFile="FM_Fault_ID.h", DataType="Fault_ID", Min=0, Max=65535)
FM_Test2_Fault_ID = Simulink.Parameter(2, StorageClass="Define", HeaderFile="FM_Fault_ID.h", DataType="Fault_ID", Min=0, Max=65535)
FM_Test3_Fault_ID = Simulink.Parameter(3, StorageClass="Define", HeaderFile="FM_Fault_ID.h", DataType="Fault_ID", Min=0, Max=65535)
FM_Test4_Fault_ID = Simulink.Parameter(4, StorageClass="Define", HeaderFile="FM_Fault_ID.h", DataType="Fault_ID", Min=0, Max=65535)
FM_Default_No_Fault_ID = Simulink.Parameter(0, StorageClass="Define", HeaderFile="FM_Fault_ID.h", DataType="Fault_ID", Min=0, Max=65535)
FM_EGRVlv_GovDvtMax_Fault_ID = Simulink.Parameter(14, StorageClass="Define", HeaderFile="FM_Fault_ID.h", DataType="Fault_ID", Min=0, Max=65535)
FM_EGRVlv_GovDvtMin_Fault_ID = Simulink.Parameter(15, StorageClass="Define", HeaderFile="FM_Fault_ID.h", DataType="Fault_ID", Min=0, Max=65535)
FM_EGRVlv_SensSRCMax_Fault_ID = Simulink.Parameter(16, StorageClass="Define", HeaderFile="FM_Fault_ID.h", DataType="Fault_ID", Min=0, Max=65535)
FM_EGRVlv_SensSRCMin_Fault_ID = Simulink.Parameter(17, StorageClass="Define", HeaderFile="FM_Fault_ID.h", DataType="Fault_ID", Min=0, Max=65535)
FM_EGRVlv_SensPRCMax_Fault_ID = Simulink.Parameter(18, StorageClass="Define", HeaderFile="FM_Fault_ID.h", DataType="Fault_ID", Min=0, Max=65535)
FM_EGRVlv_SensPRCMin_Fault_ID = Simulink.Parameter(19, StorageClass="Define", HeaderFile="FM_Fault_ID.h", DataType="Fault_ID", Min=0, Max=65535)
FM_RailP_SRCMax_Fault_ID = Simulink.Parameter(20, StorageClass="Define", HeaderFile="FM_Fault_ID.h", DataType="Fault_ID", Min=0, Max=65535)
FM_RailP_SRCMin_Fault_ID = Simulink.Parameter(21, StorageClass="Define", HeaderFile="FM_Fault_ID.h", DataType="Fault_ID", Min=0, Max=65535)
FM_APP1_SRCMax_Fault_ID = Simulink.Parameter(22, StorageClass="Define", HeaderFile="FM_Fault_ID.h", DataType="Fault_ID", Min=0, Max=65535)
FM_APP1_SRCMin_Fault_ID = Simulink.Parameter(23, StorageClass="Define", HeaderFile="FM_Fault_ID.h", DataType="Fault_ID", Min=0, Max=65535)
FM_APP2_SRCMax_Fault_ID = Simulink.Parameter(24, StorageClass="Define", HeaderFile="FM_Fault_ID.h", DataType="Fault_ID", Min=0, Max=65535)
FM_APP2_SRCMin_Fault_ID = Simulink.Parameter(25, StorageClass="Define", HeaderFile="FM_Fault_ID.h", DataType="Fault_ID", Min=0, Max=65535)
FM_Test5_Fault_ID = Simulink.Parameter(5, StorageClass="Define", HeaderFile="FM_Fault_ID.h", DataType="Fault_ID", Min=0, Max=65535)
FM_All_Fault_Status_Array = Simulink.Signal(StorageClass="ImportedExtern", DataType="boolean", Min=0, Max=1, Dimensions=[1 100], InitialValue="zeros(1,100)")  % 整个工程所有故障的故障状态数组：数组索引为故障编号，范围为0~65535；数组元素为故障状态，逻辑值，1表示当前故障编号对应故障已确认，0表示无故障或故障已恢复。