% Simulink data dictionary sl_const.sldd
% references sl_ddtypes.sldd

TRQ_MAX_SC = Simulink.Parameter(3000, StorageClass="Define", HeaderFile="sl_Const_Paras.h", DataType="Torq", Unit="Nm")  % Maxmum Torque
TRQ_MIN_SC = Simulink.Parameter(-3000, StorageClass="Define", HeaderFile="sl_Const_Paras.h", DataType="Torq", Unit="Nm")  % Minmum Torque
ERPM_MAX_SC = Simulink.Parameter(10000, StorageClass="Define", HeaderFile="sl_Const_Paras.h", DataType="ERPM", Unit="RPM")  % Maxmum Engine Speed