% Simulink data dictionary sl_ddtypes.sldd

EnvP = Simulink.NumericType(DataTypeMode="Fixed-point: slope and bias scaling", SignednessBool=true, WordLength=16, FixedExponent=-7, SlopeAdjustmentFactor=1.28, DataScope="Exported", HeaderFile="sl_ddtypes.h")  % atmospheric pressure, kpa
EnvT_C = Simulink.NumericType(DataTypeMode="Fixed-point: slope and bias scaling", SignednessBool=true, WordLength=16, FixedExponent=-7, SlopeAdjustmentFactor=1.28, DataScope="Exported", HeaderFile="sl_ddtypes.h")  % atmospheric Temperature, ℃
EnvT_K = Simulink.NumericType(DataTypeMode="Fixed-point: slope and bias scaling", SignednessBool=true, WordLength=16, FixedExponent=-6, SlopeAdjustmentFactor=1.28, DataScope="Exported", HeaderFile="sl_ddtypes.h")  % atmospheric Temperature, K
Fac1 = Simulink.NumericType(DataTypeMode="Fixed-point: slope and bias scaling", SignednessBool=false, WordLength=16, FixedExponent=-14, SlopeAdjustmentFactor=1.6384, DataScope="Exported", HeaderFile="sl_ddtypes.h")  % 无符号系数，大致范围0~5
Fac10 = Simulink.NumericType(DataTypeMode="Fixed-point: slope and bias scaling", SignednessBool=false, WordLength=16, FixedExponent=-10, SlopeAdjustmentFactor=1.024, DataScope="Exported", HeaderFile="sl_ddtypes.h")  % 无符号系数，大致范围0~50
Fac100 = Simulink.NumericType(DataTypeMode="Fixed-point: slope and bias scaling", SignednessBool=false, WordLength=16, FixedExponent=-9, SlopeAdjustmentFactor=1.024, DataScope="Exported", HeaderFile="sl_ddtypes.h")  % 无符号系数，大致范围0~100
Fac_1 = Simulink.NumericType(DataTypeMode="Fixed-point: slope and bias scaling", SignednessBool=true, WordLength=16, FixedExponent=-14, SlopeAdjustmentFactor=1.6384, DataScope="Exported", HeaderFile="sl_ddtypes.h")  % 有符号系数，大致范围-1~1
Fac_10 = Simulink.NumericType(DataTypeMode="Fixed-point: slope and bias scaling", SignednessBool=true, WordLength=16, FixedExponent=-10, SlopeAdjustmentFactor=1.024, DataScope="Exported", HeaderFile="sl_ddtypes.h")  % 有符号系数，大致范围-30~30
Fac_100 = Simulink.NumericType(DataTypeMode="Fixed-point: slope and bias scaling", SignednessBool=true, WordLength=16, FixedExponent=-8, SlopeAdjustmentFactor=1.28, DataScope="Exported", HeaderFile="sl_ddtypes.h")  % 有符号系数，大致范围-100~100
Percent = Simulink.NumericType(DataTypeMode="Fixed-point: slope and bias scaling", SignednessBool=true, WordLength=16, FixedExponent=-8, SlopeAdjustmentFactor=1.28, DataScope="Exported", HeaderFile="sl_ddtypes.h")  % 百分比，0~100, %
Percent_s = Simulink.NumericType(DataTypeMode="Fixed-point: slope and bias scaling", SignednessBool=true, WordLength=16, FixedExponent=-7, SlopeAdjustmentFactor=1.28, DataScope="Exported", HeaderFile="sl_ddtypes.h")  % 百分比变化率，0~100, %/s
DutyCycle = Simulink.NumericType(DataTypeMode="Fixed-point: slope and bias scaling", SignednessBool=true, WordLength=16, FixedExponent=-8, SlopeAdjustmentFactor=1.28, DataScope="Exported", HeaderFile="sl_ddtypes.h")  % 占空比，0~100, %
Ratio = Simulink.NumericType(DataTypeMode="Fixed-point: slope and bias scaling", SignednessBool=false, WordLength=16, FixedExponent=-9, SlopeAdjustmentFactor=1.024, DataScope="Exported", HeaderFile="sl_ddtypes.h")  % 比值，大致范围0~100, %
Ratio_100 = Simulink.NumericType(DataTypeMode="Fixed-point: slope and bias scaling", SignednessBool=true, WordLength=16, FixedExponent=-8, SlopeAdjustmentFactor=1.28, DataScope="Exported", HeaderFile="sl_ddtypes.h")  % 比值，大致范围-100~100, %
Rate = Simulink.NumericType(DataTypeMode="Fixed-point: slope and bias scaling", SignednessBool=false, WordLength=16, FixedExponent=-9, SlopeAdjustmentFactor=1.024, DataScope="Exported", HeaderFile="sl_ddtypes.h")  % 负载率，大致范围0~100, %
Effcy = Simulink.NumericType(DataTypeMode="Fixed-point: slope and bias scaling", SignednessBool=true, WordLength=16, FixedExponent=-8, SlopeAdjustmentFactor=1.28, DataScope="Exported", HeaderFile="sl_ddtypes.h")  % 效率，大致范围0~100, %
Day = Simulink.NumericType(DataTypeMode="Fixed-point: slope and bias scaling", SignednessBool=true, WordLength=16, FixedExponent=-4, SlopeAdjustmentFactor=1.6, DataScope="Exported", HeaderFile="sl_ddtypes.h")  % 时间，天数
Day1 = Simulink.NumericType(DataTypeMode="Fixed-point: slope and bias scaling", SignednessBool=true, WordLength=16, FixedExponent=0, DataScope="Exported", HeaderFile="sl_ddtypes.h")  % 时间，天数，分辨率0.1
Hours = Simulink.NumericType(DataTypeMode="Fixed-point: slope and bias scaling", SignednessBool=true, WordLength=16, FixedExponent=-7, SlopeAdjustmentFactor=1.28, DataScope="Exported", HeaderFile="sl_ddtypes.h")  % 时间，小时
Hours1 = Simulink.NumericType(DataTypeMode="Fixed-point: slope and bias scaling", SignednessBool=true, WordLength=16, FixedExponent=-4, SlopeAdjustmentFactor=1.6, DataScope="Exported", HeaderFile="sl_ddtypes.h")  % 时间，小时，分辨率0.1
Seconds = Simulink.NumericType(DataTypeMode="Fixed-point: slope and bias scaling", SignednessBool=true, WordLength=16, FixedExponent=-4, SlopeAdjustmentFactor=1.6, DataScope="Exported", HeaderFile="sl_ddtypes.h")  % 时间，秒
Seconds1 = Simulink.NumericType(DataTypeMode="Fixed-point: slope and bias scaling", SignednessBool=true, WordLength=16, FixedExponent=0, DataScope="Exported", HeaderFile="sl_ddtypes.h")  % 时间，秒，分辨率0.1
Seconds4 = Simulink.NumericType(DataTypeMode="Fixed-point: slope and bias scaling", SignednessBool=true, WordLength=32, FixedExponent=-4, SlopeAdjustmentFactor=1.6, DataScope="Exported", HeaderFile="sl_ddtypes.h")  % 时间，秒，大范围
mSec = Simulink.NumericType(DataTypeMode="Fixed-point: slope and bias scaling", SignednessBool=true, WordLength=16, FixedExponent=-4, SlopeAdjustmentFactor=1.6, DataScope="Exported", HeaderFile="sl_ddtypes.h")  % 时间，毫秒
mSec1 = Simulink.NumericType(DataTypeMode="Fixed-point: slope and bias scaling", SignednessBool=true, WordLength=16, FixedExponent=0, DataScope="Exported", HeaderFile="sl_ddtypes.h")  % 时间，毫秒，分辨率0.1
mSec4 = Simulink.NumericType(DataTypeMode="Fixed-point: slope and bias scaling", SignednessBool=true, WordLength=32, FixedExponent=-4, SlopeAdjustmentFactor=1.6, DataScope="Exported", HeaderFile="sl_ddtypes.h")  % 时间，毫秒，大范围
uSec = Simulink.NumericType(DataTypeMode="Fixed-point: slope and bias scaling", SignednessBool=true, WordLength=16, FixedExponent=-4, SlopeAdjustmentFactor=1.6, DataScope="Exported", HeaderFile="sl_ddtypes.h")  % 时间，微秒
uSec1 = Simulink.NumericType(DataTypeMode="Fixed-point: slope and bias scaling", SignednessBool=true, WordLength=16, FixedExponent=0, DataScope="Exported", HeaderFile="sl_ddtypes.h")  % 时间，微秒，分辨率0.1
uSec4 = Simulink.NumericType(DataTypeMode="Fixed-point: slope and bias scaling", SignednessBool=true, WordLength=32, FixedExponent=-4, SlopeAdjustmentFactor=1.6, DataScope="Exported", HeaderFile="sl_ddtypes.h")  % 时间，微秒，大范围
Delay_ms = Simulink.NumericType(DataTypeMode="Fixed-point: slope and bias scaling", SignednessBool=false, WordLength=16, FixedExponent=-4, SlopeAdjustmentFactor=1.6, DataScope="Exported", HeaderFile="sl_ddtypes.h")  % 延迟时间，毫秒
Delay_s = Simulink.NumericType(DataTypeMode="Fixed-point: slope and bias scaling", SignednessBool=false, WordLength=16, FixedExponent=-4, SlopeAdjustmentFactor=1.6, DataScope="Exported", HeaderFile="sl_ddtypes.h")  % 延迟时间，秒
Debncd_ms = Simulink.NumericType(DataTypeMode="Fixed-point: slope and bias scaling", SignednessBool=false, WordLength=16, FixedExponent=-4, SlopeAdjustmentFactor=1.6, DataScope="Exported", HeaderFile="sl_ddtypes.h")  % 去抖时间，毫秒
Debncd_s = Simulink.NumericType(DataTypeMode="Fixed-point: slope and bias scaling", SignednessBool=false, WordLength=16, FixedExponent=-4, SlopeAdjustmentFactor=1.6, DataScope="Exported", HeaderFile="sl_ddtypes.h")  % 去抖时间，秒
TON_ms = Simulink.NumericType(DataTypeMode="Fixed-point: slope and bias scaling", SignednessBool=false, WordLength=16, FixedExponent=-4, SlopeAdjustmentFactor=1.6, DataScope="Exported", HeaderFile="sl_ddtypes.h")  % 累计时间，毫秒
TON_s = Simulink.NumericType(DataTypeMode="Fixed-point: slope and bias scaling", SignednessBool=false, WordLength=16, FixedExponent=-4, SlopeAdjustmentFactor=1.6, DataScope="Exported", HeaderFile="sl_ddtypes.h")  % 累计时间，秒
TON_h = Simulink.NumericType(DataTypeMode="Fixed-point: slope and bias scaling", SignednessBool=false, WordLength=16, FixedExponent=-4, SlopeAdjustmentFactor=1.6, DataScope="Exported", HeaderFile="sl_ddtypes.h")  % 累计时间，小时
Period_s = Simulink.NumericType(DataTypeMode="Fixed-point: slope and bias scaling", SignednessBool=false, WordLength=16, FixedExponent=-7, SlopeAdjustmentFactor=1.28, DataScope="Exported", HeaderFile="sl_ddtypes.h")  % 周期，秒
Period_s1 = Simulink.NumericType(DataTypeMode="Fixed-point: slope and bias scaling", SignednessBool=false, WordLength=16, FixedExponent=-4, SlopeAdjustmentFactor=1.6, DataScope="Exported", HeaderFile="sl_ddtypes.h")  % 周期，秒，分辨率0.1
Period_ms = Simulink.NumericType(DataTypeMode="Fixed-point: slope and bias scaling", SignednessBool=false, WordLength=16, FixedExponent=-7, SlopeAdjustmentFactor=1.28, DataScope="Exported", HeaderFile="sl_ddtypes.h")  % 周期，毫秒
Period_ms1 = Simulink.NumericType(DataTypeMode="Fixed-point: slope and bias scaling", SignednessBool=false, WordLength=16, FixedExponent=-4, SlopeAdjustmentFactor=1.6, DataScope="Exported", HeaderFile="sl_ddtypes.h")  % 周期，毫秒，分辨率0.1
Period_us = Simulink.NumericType(DataTypeMode="Fixed-point: slope and bias scaling", SignednessBool=false, WordLength=16, FixedExponent=-4, SlopeAdjustmentFactor=1.6, DataScope="Exported", HeaderFile="sl_ddtypes.h")  % 周期，微秒
Volt_mV = Simulink.NumericType(DataTypeMode="Fixed-point: slope and bias scaling", SignednessBool=true, WordLength=16, FixedExponent=0, DataScope="Exported", HeaderFile="sl_ddtypes.h")  % 电压，mV
Volt_mV1 = Simulink.NumericType(DataTypeMode="Fixed-point: slope and bias scaling", SignednessBool=true, WordLength=16, FixedExponent=-4, SlopeAdjustmentFactor=1.6, DataScope="Exported", HeaderFile="sl_ddtypes.h")  % 电压，mV，分辨率0.1
Volt_mV_s = Simulink.NumericType(DataTypeMode="Fixed-point: slope and bias scaling", SignednessBool=true, WordLength=16, FixedExponent=0, DataScope="Exported", HeaderFile="sl_ddtypes.h")  % 电压变化率，mV/s
VoltV = Simulink.NumericType(DataTypeMode="Fixed-point: slope and bias scaling", SignednessBool=true, WordLength=16, FixedExponent=-7, SlopeAdjustmentFactor=1.28, DataScope="Exported", HeaderFile="sl_ddtypes.h")  % 电压，V
VoltV1 = Simulink.NumericType(DataTypeMode="Fixed-point: slope and bias scaling", SignednessBool=true, WordLength=16, FixedExponent=-4, SlopeAdjustmentFactor=1.6, DataScope="Exported", HeaderFile="sl_ddtypes.h")  % 电压，V，分辨率0.1
Current_mA = Simulink.NumericType(DataTypeMode="Fixed-point: slope and bias scaling", SignednessBool=true, WordLength=16, FixedExponent=0, DataScope="Exported", HeaderFile="sl_ddtypes.h")  % 电流，毫安
Current_mA2 = Simulink.NumericType(DataTypeMode="Fixed-point: slope and bias scaling", SignednessBool=true, WordLength=16, FixedExponent=-4, SlopeAdjustmentFactor=1.6, DataScope="Exported", HeaderFile="sl_ddtypes.h")  % 电流，毫安，分辨率0.1
Current_A = Simulink.NumericType(DataTypeMode="Fixed-point: slope and bias scaling", SignednessBool=true, WordLength=16, FixedExponent=-7, SlopeAdjustmentFactor=1.28, DataScope="Exported", HeaderFile="sl_ddtypes.h")  % 电流，安
Current_A1 = Simulink.NumericType(DataTypeMode="Fixed-point: slope and bias scaling", SignednessBool=true, WordLength=16, FixedExponent=-4, SlopeAdjustmentFactor=1.6, DataScope="Exported", HeaderFile="sl_ddtypes.h")  % 电流，安，分辨率0.1
Mass_mg = Simulink.NumericType(DataTypeMode="Fixed-point: slope and bias scaling", SignednessBool=true, WordLength=16, FixedExponent=0, DataScope="Exported", HeaderFile="sl_ddtypes.h")  % 质量，毫克
Mass_mg1 = Simulink.NumericType(DataTypeMode="Fixed-point: slope and bias scaling", SignednessBool=true, WordLength=16, FixedExponent=-4, SlopeAdjustmentFactor=1.6, DataScope="Exported", HeaderFile="sl_ddtypes.h")  % 质量，毫克，分辨率0.1
Mass_g = Simulink.NumericType(DataTypeMode="Fixed-point: slope and bias scaling", SignednessBool=true, WordLength=16, FixedExponent=0, DataScope="Exported", HeaderFile="sl_ddtypes.h")  % 质量，克
Mass_g1 = Simulink.NumericType(DataTypeMode="Fixed-point: slope and bias scaling", SignednessBool=true, WordLength=16, FixedExponent=-4, SlopeAdjustmentFactor=1.6, DataScope="Exported", HeaderFile="sl_ddtypes.h")  % 质量，克，分辨率0.1
Mass_g4 = Simulink.NumericType(DataTypeMode="Fixed-point: slope and bias scaling", SignednessBool=true, WordLength=32, FixedExponent=-7, SlopeAdjustmentFactor=1.28, DataScope="Exported", HeaderFile="sl_ddtypes.h")  % 质量，克，大范围
Mass_kg = Simulink.NumericType(DataTypeMode="Fixed-point: slope and bias scaling", SignednessBool=true, WordLength=16, FixedExponent=-7, SlopeAdjustmentFactor=1.28, DataScope="Exported", HeaderFile="sl_ddtypes.h")  % 质量，千克
Mass_kg1 = Simulink.NumericType(DataTypeMode="Fixed-point: slope and bias scaling", SignednessBool=true, WordLength=16, FixedExponent=-4, SlopeAdjustmentFactor=1.6, DataScope="Exported", HeaderFile="sl_ddtypes.h")  % 质量，千克，分辨率0.1
InjMass = Simulink.NumericType(DataTypeMode="Fixed-point: slope and bias scaling", SignednessBool=true, WordLength=16, FixedExponent=-7, SlopeAdjustmentFactor=1.28, DataScope="Exported", HeaderFile="sl_ddtypes.h")  % 质量，毫克/冲程或每次喷射
InjMass1 = Simulink.NumericType(DataTypeMode="Fixed-point: slope and bias scaling", SignednessBool=true, WordLength=16, FixedExponent=-4, SlopeAdjustmentFactor=1.6, DataScope="Exported", HeaderFile="sl_ddtypes.h")  % 质量，毫克/冲程或每次喷射，分辨率0.1
InjMass2 = Simulink.NumericType(DataTypeMode="Fixed-point: slope and bias scaling", SignednessBool=true, WordLength=16, FixedExponent=0, DataScope="Exported", HeaderFile="sl_ddtypes.h")  % 质量，毫克/冲程或每次喷射，分辨率1
mFlow_gps = Simulink.NumericType(DataTypeMode="Fixed-point: slope and bias scaling", SignednessBool=true, WordLength=16, FixedExponent=-7, SlopeAdjustmentFactor=1.28, DataScope="Exported", HeaderFile="sl_ddtypes.h")  % 质量流量，g/s
mFlow_kgph = Simulink.NumericType(DataTypeMode="Fixed-point: slope and bias scaling", SignednessBool=true, WordLength=16, FixedExponent=-4, SlopeAdjustmentFactor=1.6, DataScope="Exported", HeaderFile="sl_ddtypes.h")  % 质量流量，kg/h
vFlow_m3ph = Simulink.NumericType(DataTypeMode="Fixed-point: slope and bias scaling", SignednessBool=true, WordLength=16, FixedExponent=-4, SlopeAdjustmentFactor=1.6, DataScope="Exported", HeaderFile="sl_ddtypes.h")  % 体积流量，立方米每小时
vFlow_mm3ps = Simulink.NumericType(DataTypeMode="Fixed-point: slope and bias scaling", SignednessBool=true, WordLength=16, FixedExponent=0, DataScope="Exported", HeaderFile="sl_ddtypes.h")  % 体积流量，立方豪米每秒
Density_kgpm3 = Simulink.NumericType(DataTypeMode="Fixed-point: slope and bias scaling", SignednessBool=true, WordLength=16, FixedExponent=-4, SlopeAdjustmentFactor=1.6, DataScope="Exported", HeaderFile="sl_ddtypes.h")  % 密度，kg/m3
Density_gpcm3 = Simulink.NumericType(DataTypeMode="Fixed-point: slope and bias scaling", SignednessBool=true, WordLength=16, FixedExponent=-4, SlopeAdjustmentFactor=1.6, DataScope="Exported", HeaderFile="sl_ddtypes.h")  % 密度，g/cm3
Length_m = Simulink.NumericType(DataTypeMode="Fixed-point: slope and bias scaling", SignednessBool=true, WordLength=16, FixedExponent=-7, SlopeAdjustmentFactor=1.28, DataScope="Exported", HeaderFile="sl_ddtypes.h")  % 长度，米
Length_mm = Simulink.NumericType(DataTypeMode="Fixed-point: slope and bias scaling", SignednessBool=true, WordLength=16, FixedExponent=-7, SlopeAdjustmentFactor=1.28, DataScope="Exported", HeaderFile="sl_ddtypes.h")  % 长度，毫米
Length_cm = Simulink.NumericType(DataTypeMode="Fixed-point: slope and bias scaling", SignednessBool=true, WordLength=16, FixedExponent=-7, SlopeAdjustmentFactor=1.28, DataScope="Exported", HeaderFile="sl_ddtypes.h")  % 长度，厘米
Height_m = Simulink.NumericType(DataTypeMode="Fixed-point: slope and bias scaling", SignednessBool=true, WordLength=16, FixedExponent=-7, SlopeAdjustmentFactor=1.28, DataScope="Exported", HeaderFile="sl_ddtypes.h")  % 长度，米
Height_mm = Simulink.NumericType(DataTypeMode="Fixed-point: slope and bias scaling", SignednessBool=true, WordLength=16, FixedExponent=-7, SlopeAdjustmentFactor=1.28, DataScope="Exported", HeaderFile="sl_ddtypes.h")  % 长度，毫米
Height_cm = Simulink.NumericType(DataTypeMode="Fixed-point: slope and bias scaling", SignednessBool=true, WordLength=16, FixedExponent=-7, SlopeAdjustmentFactor=1.28, DataScope="Exported", HeaderFile="sl_ddtypes.h")  % 长度，厘米
Vol_m3 = Simulink.NumericType(DataTypeMode="Fixed-point: slope and bias scaling", SignednessBool=true, WordLength=16, FixedExponent=-7, SlopeAdjustmentFactor=1.28, DataScope="Exported", HeaderFile="sl_ddtypes.h")  % 体积，立方米
Vol_cm3 = Simulink.NumericType(DataTypeMode="Fixed-point: slope and bias scaling", SignednessBool=true, WordLength=16, FixedExponent=-7, SlopeAdjustmentFactor=1.28, DataScope="Exported", HeaderFile="sl_ddtypes.h")  % 体积，立方厘米
Vol_L = Simulink.NumericType(DataTypeMode="Fixed-point: slope and bias scaling", SignednessBool=true, WordLength=16, FixedExponent=-7, SlopeAdjustmentFactor=1.28, DataScope="Exported", HeaderFile="sl_ddtypes.h")  % 体积，升，立方分米
Vol_mL = Simulink.NumericType(DataTypeMode="Fixed-point: slope and bias scaling", SignednessBool=true, WordLength=16, FixedExponent=-7, SlopeAdjustmentFactor=1.28, DataScope="Exported", HeaderFile="sl_ddtypes.h")  % 体积，毫升，立方厘米
Area_m2 = Simulink.NumericType(DataTypeMode="Fixed-point: slope and bias scaling", SignednessBool=true, WordLength=16, FixedExponent=-7, SlopeAdjustmentFactor=1.28, DataScope="Exported", HeaderFile="sl_ddtypes.h")  % 面积，平方米
Area_mm2 = Simulink.NumericType(DataTypeMode="Fixed-point: slope and bias scaling", SignednessBool=true, WordLength=16, FixedExponent=-7, SlopeAdjustmentFactor=1.28, DataScope="Exported", HeaderFile="sl_ddtypes.h")  % 面积，平方毫米
Area_cm2 = Simulink.NumericType(DataTypeMode="Fixed-point: slope and bias scaling", SignednessBool=true, WordLength=16, FixedExponent=-7, SlopeAdjustmentFactor=1.28, DataScope="Exported", HeaderFile="sl_ddtypes.h")  % 面积，平方厘米
RPM = Simulink.NumericType(DataTypeMode="Fixed-point: slope and bias scaling", SignednessBool=true, WordLength=16, FixedExponent=-4, SlopeAdjustmentFactor=1.6, DataScope="Exported", HeaderFile="sl_ddtypes.h")  % 转速，转每分钟
RPM_s = Simulink.NumericType(DataTypeMode="Fixed-point: slope and bias scaling", SignednessBool=true, WordLength=16, FixedExponent=-4, SlopeAdjustmentFactor=1.6, DataScope="Exported", HeaderFile="sl_ddtypes.h")  % 转速变化率，转每分钟每秒
ERPM = Simulink.NumericType(DataTypeMode="Fixed-point: slope and bias scaling", SignednessBool=true, WordLength=16, FixedExponent=-1, DataScope="Exported", HeaderFile="sl_ddtypes.h")  % 发动机转速，转每分钟
ERPM_s = Simulink.NumericType(DataTypeMode="Fixed-point: slope and bias scaling", SignednessBool=true, WordLength=16, FixedExponent=-1, DataScope="Exported", HeaderFile="sl_ddtypes.h")  % 发动机转速变化率，转每分钟每秒
RPM_k = Simulink.NumericType(DataTypeMode="Fixed-point: slope and bias scaling", SignednessBool=true, WordLength=16, FixedExponent=-7, SlopeAdjustmentFactor=1.28, DataScope="Exported", HeaderFile="sl_ddtypes.h")  % 转速，千转每分钟
V_mps = Simulink.NumericType(DataTypeMode="Fixed-point: slope and bias scaling", SignednessBool=true, WordLength=16, FixedExponent=-7, SlopeAdjustmentFactor=1.28, DataScope="Exported", HeaderFile="sl_ddtypes.h")  % 速度，米每秒
V_kmph = Simulink.NumericType(DataTypeMode="Fixed-point: slope and bias scaling", SignednessBool=true, WordLength=16, FixedExponent=-7, SlopeAdjustmentFactor=1.28, DataScope="Exported", HeaderFile="sl_ddtypes.h")  % 速度，千米每小时
Accel_ms2 = Simulink.NumericType(DataTypeMode="Fixed-point: slope and bias scaling", SignednessBool=true, WordLength=16, FixedExponent=-7, SlopeAdjustmentFactor=1.28, DataScope="Exported", HeaderFile="sl_ddtypes.h")  % 加速度，米每二次方秒
Torq = Simulink.NumericType(DataTypeMode="Fixed-point: slope and bias scaling", SignednessBool=true, WordLength=16, FixedExponent=-4, SlopeAdjustmentFactor=1.6, DataScope="Exported", HeaderFile="sl_ddtypes.h")  % 扭矩，NM
Torq_s = Simulink.NumericType(DataTypeMode="Fixed-point: slope and bias scaling", SignednessBool=true, WordLength=16, FixedExponent=-4, SlopeAdjustmentFactor=1.6, DataScope="Exported", HeaderFile="sl_ddtypes.h")  % 扭矩变化率，NM/s
Angle = Simulink.NumericType(DataTypeMode="Fixed-point: slope and bias scaling", SignednessBool=true, WordLength=16, FixedExponent=-7, SlopeAdjustmentFactor=1.28, DataScope="Exported", HeaderFile="sl_ddtypes.h")  % 角度
Angle_CA = Simulink.NumericType(DataTypeMode="Fixed-point: slope and bias scaling", SignednessBool=true, WordLength=16, FixedExponent=-5, SlopeAdjustmentFactor=1.6, DataScope="Exported", HeaderFile="sl_ddtypes.h")  % 角度，曲轴角度
Press_bar = Simulink.NumericType(DataTypeMode="Fixed-point: slope and bias scaling", SignednessBool=true, WordLength=16, FixedExponent=-7, SlopeAdjustmentFactor=1.28, DataScope="Exported", HeaderFile="sl_ddtypes.h")  % 压强，bar
Press_bar1 = Simulink.NumericType(DataTypeMode="Fixed-point: slope and bias scaling", SignednessBool=true, WordLength=16, FixedExponent=-4, SlopeAdjustmentFactor=1.6, DataScope="Exported", HeaderFile="sl_ddtypes.h")  % 压强，bar
Press_kpa = Simulink.NumericType(DataTypeMode="Fixed-point: slope and bias scaling", SignednessBool=true, WordLength=16, FixedExponent=-4, SlopeAdjustmentFactor=1.6, DataScope="Exported", HeaderFile="sl_ddtypes.h")  % 压强，千帕
Temp_C = Simulink.NumericType(DataTypeMode="Fixed-point: slope and bias scaling", SignednessBool=true, WordLength=16, FixedExponent=-4, SlopeAdjustmentFactor=1.6, DataScope="Exported", HeaderFile="sl_ddtypes.h")  % 温度，摄氏度
Temp_K = Simulink.NumericType(DataTypeMode="Fixed-point: slope and bias scaling", SignednessBool=true, WordLength=16, FixedExponent=-4, SlopeAdjustmentFactor=1.6, DataScope="Exported", HeaderFile="sl_ddtypes.h")  % 温度，K
Power_w = Simulink.NumericType(DataTypeMode="Fixed-point: slope and bias scaling", SignednessBool=true, WordLength=16, FixedExponent=-7, SlopeAdjustmentFactor=1.28, DataScope="Exported", HeaderFile="sl_ddtypes.h")  % 功率，瓦
Power_kw = Simulink.NumericType(DataTypeMode="Fixed-point: slope and bias scaling", SignednessBool=true, WordLength=16, FixedExponent=-7, SlopeAdjustmentFactor=1.28, DataScope="Exported", HeaderFile="sl_ddtypes.h")  % 功率，千瓦
Energy_J = Simulink.NumericType(DataTypeMode="Fixed-point: slope and bias scaling", SignednessBool=true, WordLength=16, FixedExponent=-7, SlopeAdjustmentFactor=1.28, DataScope="Exported", HeaderFile="sl_ddtypes.h")  % 能量，J
Energy_kJ = Simulink.NumericType(DataTypeMode="Fixed-point: slope and bias scaling", SignednessBool=true, WordLength=16, FixedExponent=-7, SlopeAdjustmentFactor=1.28, DataScope="Exported", HeaderFile="sl_ddtypes.h")  % 能量，kJ
Distance_m = Simulink.NumericType(DataTypeMode="Fixed-point: slope and bias scaling", SignednessBool=true, WordLength=16, FixedExponent=-7, SlopeAdjustmentFactor=1.28, DataScope="Exported", HeaderFile="sl_ddtypes.h")  % 距离，里程，米
Distance_km = Simulink.NumericType(DataTypeMode="Fixed-point: slope and bias scaling", SignednessBool=true, WordLength=16, FixedExponent=-7, SlopeAdjustmentFactor=1.28, DataScope="Exported", HeaderFile="sl_ddtypes.h")  % 距离，里程，千米
Distance_km1 = Simulink.NumericType(DataTypeMode="Fixed-point: slope and bias scaling", SignednessBool=true, WordLength=16, FixedExponent=-4, SlopeAdjustmentFactor=1.6, DataScope="Exported", HeaderFile="sl_ddtypes.h")  % 距离，里程，千米，分辨率0.1
Distance_km4 = Simulink.NumericType(DataTypeMode="Fixed-point: slope and bias scaling", SignednessBool=true, WordLength=32, FixedExponent=-4, SlopeAdjustmentFactor=1.6, DataScope="Exported", HeaderFile="sl_ddtypes.h")  % 距离，里程，千米，大范围
Concen_p = Simulink.NumericType(DataTypeMode="Fixed-point: slope and bias scaling", SignednessBool=true, WordLength=16, FixedExponent=-7, SlopeAdjustmentFactor=1.28, DataScope="Exported", HeaderFile="sl_ddtypes.h")  % 浓度，百分比
Concen_ppm = Simulink.NumericType(DataTypeMode="Fixed-point: slope and bias scaling", SignednessBool=true, WordLength=16, FixedExponent=-4, SlopeAdjustmentFactor=1.6, DataScope="Exported", HeaderFile="sl_ddtypes.h")  % 浓度，1/10^6
TraGear = Simulink.AliasType(BaseType="uint8", DataScope="Exported", HeaderFile="sl_ddtypes.h")  % 档位
Pin_No = Simulink.AliasType(BaseType="uint16", DataScope="Exported", HeaderFile="sl_ddtypes.h")  % ECU针脚号
Fault_No = Simulink.AliasType(BaseType="uint16", DataScope="Exported", HeaderFile="sl_ddtypes.h")  % 故障号
State = Simulink.AliasType(BaseType="uint8", DataScope="Exported", HeaderFile="sl_ddtypes.h")  % 状态，每一位位代表不同的含义
State2 = Simulink.AliasType(BaseType="uint16", DataScope="Exported", HeaderFile="sl_ddtypes.h")  % 状态，每一位位代表不同的含义
State4 = Simulink.AliasType(BaseType="uint32", DataScope="Exported", HeaderFile="sl_ddtypes.h")  % 状态，每一位位代表不同的含义
Count = Simulink.AliasType(BaseType="uint8", DataScope="Exported", HeaderFile="sl_ddtypes.h")  % 计数
Count2 = Simulink.AliasType(BaseType="uint16", DataScope="Exported", HeaderFile="sl_ddtypes.h")  % 计数
Count4 = Simulink.AliasType(BaseType="uint32", DataScope="Exported", HeaderFile="sl_ddtypes.h")  % 计数

Switch = enum(DataScope="Exported", HeaderFile="sl_ddtypes.h", DefaultValue="OFF", AddClassNameToEnumNames=true)
  OFF = 0
  ON = 1

EngState = enum(DataScope="Exported", HeaderFile="sl_ddtypes.h", DefaultValue="STOPPED", AddClassNameToEnumNames=true)
  STOPPED = 0
  CRANKING = 1
  RUNNING = 2
  STOPPING = 3

ECUPowerState = enum(DataScope="Exported", HeaderFile="sl_ddtypes.h", DefaultValue="PowerOFF", AddClassNameToEnumNames=true)
  PowerOFF = 0
  PowerON = 2
  PowerLatch = 3

EpmSynState = enum(DataScope="Exported", HeaderFile="sl_ddtypes.h", DefaultValue="NO_SYNC", AddClassNameToEnumNames=true)
  NO_SYNC = 0
  FULL_SYNC = 10
  HALF_SYNC = 20
  CRS_SYNC = 30
  CAS_SYNC = 40

TraType = enum(DataScope="Exported", HeaderFile="sl_ddtypes.h", DefaultValue="TRA_MT", AddClassNameToEnumNames=true)
  TRA_MT = 0
  TRA_AT = 1
  TRA_AMT = 2
  TRA_CVT = 3
  TRA_DCT = 4