% Simulink data dictionary CEngDsT_DD.sldd
% references slprj_cm.sldd
% references sl_ddtypes.sldd
% references sl_const.sldd
% references slprj_FM.sldd

CEngDsT_tSens = Simulink.Signal(StorageClass="ExportedGlobal", DataType="Temp_C", Min=-200, Max=200, Unit="deg", InitialValue="0")  % Sensed engine coolant temperature
CEngDsT_bFinalDef = Simulink.Signal(StorageClass="ExportedGlobal", DataType="boolean", Min=0, Max=1, Unit="NaN", InitialValue="0")  % Status Sensor of the coolant temperature finally defect
CEngDsT_bProvDef = Simulink.Signal(StorageClass="ExportedGlobal", DataType="boolean", Min=0, Max=1, Unit="NaN", InitialValue="0")  % Status Sensor of the coolant temperature temporary defect
CEngDsT_bPhysRngFinalDef = Simulink.Signal(StorageClass="ExportedGlobal", DataType="boolean", Min=0, Max=1, Unit="NaN", InitialValue="0")  % Status Sensor of the CEngDsT physical Signal range check finally defect
CEngDsT_bPhysRngProvDef = Simulink.Signal(StorageClass="ExportedGlobal", DataType="boolean", Min=0, Max=1, Unit="NaN", InitialValue="0")  % Status Sensor of the CEngDsT physical Signal range check temporary defect
CEngDsT_bSRCMaxDeb_DSM = Simulink.Signal(StorageClass="ExportedGlobal", DataType="boolean", Min=0, Max=1, Unit="NaN", InitialValue="0")  % status of CEngDsT_bSRCMaxDeb
CEngDsT_bSRCMinDeb_DSM = Simulink.Signal(StorageClass="ExportedGlobal", DataType="boolean", Min=0, Max=1, Unit="NaN", InitialValue="0")  % status of CEngDsT_bSRCMinDeb
CEngDsT_bPhysRngHiDeb_DSM = Simulink.Signal(StorageClass="ExportedGlobal", DataType="boolean", Min=0, Max=1, Unit="NaN", InitialValue="0")  % status of CEngDsT_bPhysRngHiDeb
CEngDsT_bPhysRngLoDeb_DSM = Simulink.Signal(StorageClass="ExportedGlobal", DataType="boolean", Min=0, Max=1, Unit="NaN", InitialValue="0")  % status of CEngDsT_bPhysRngLoDeb
CEngDsT_bSRCMax = Simulink.Signal(StorageClass="ExportedGlobal", DataType="boolean", Min=0, Max=1, Unit="NaN", InitialValue="0")  % coolant temperature voltage signal maximum limit value
CEngDsT_bSRCMin = Simulink.Signal(StorageClass="ExportedGlobal", DataType="boolean", Min=0, Max=1, Unit="NaN", InitialValue="0")  % coolant temperature voltage signal minimum limit value
CEngDsT_bSRCMaxDeb = Simulink.Signal(StorageClass="ExportedGlobal", DataType="boolean", Min=0, Max=1, Unit="NaN", InitialValue="0")  % coolant temperature voltage signal maximum limit value debonce
CEngDsT_bSRCMinDeb = Simulink.Signal(StorageClass="ExportedGlobal", DataType="boolean", Min=0, Max=1, Unit="NaN", InitialValue="0")  % coolant temperature voltage signal minimum limit value debonce
CEngDsT_bPhysRngHi = Simulink.Signal(StorageClass="ExportedGlobal", DataType="boolean", Min=0, Max=1, Unit="NaN", InitialValue="0")  % Status Sensor of the coolant temperature high voltage Signal range
CEngDsT_bPhysRngLo = Simulink.Signal(StorageClass="ExportedGlobal", DataType="boolean", Min=0, Max=1, Unit="NaN", InitialValue="0")  % Status Sensor of the coolant temperature low voltage Signal range
CEngDsT_bPhysRngHiDeb = Simulink.Signal(StorageClass="ExportedGlobal", DataType="boolean", Min=0, Max=1, Unit="NaN", InitialValue="0")  % Status Sensor of the coolant temperature high voltage Signal range debonce
CEngDsT_bPhysRngLoDeb = Simulink.Signal(StorageClass="ExportedGlobal", DataType="boolean", Min=0, Max=1, Unit="NaN", InitialValue="0")  % Status Sensor of the coolant temperature low voltage Signal range debonce
CEngDsT_tTransf_CURX = Simulink.Parameter([0 200 400 600 800 1000 1200 1400 1600 1800 2000 2200 2400 2600 2800 3000 3200 3400 3600 3800 4000 4200 4400 4600 4800 5000], StorageClass="ConstVolatile", HeaderFile="CEngDsT_DD_Paras.h", DefinitionFile="CEngDsT_DD_Paras.c", DataType="Volt_mV2", Min=0, Max=5000, Unit="mv")  % Transformation aixs to convert the voltage value to temperature value
CEngDsT_tTransf_CUR = Simulink.Parameter(repmat(25, 1, 26), StorageClass="ConstVolatile", HeaderFile="CEngDsT_DD_Paras.h", DefinitionFile="CEngDsT_DD_Paras.c", DataType="Temp_C", Min=-50, Max=150, Unit="deg")  % Transformation curve to convert the voltage value to temperature value
CEngDsT_tiMaxDefDeb_C = Simulink.Parameter(200, StorageClass="ConstVolatile", HeaderFile="CEngDsT_DD_Paras.h", DefinitionFile="CEngDsT_DD_Paras.c", DataType="Debncd_ms", Min=0, Max=655, Unit="ms")  % Debounc time for checking heal of DFC_CEngDsTSRCMax
CEngDsT_tiMaxOKDeb_C = Simulink.Parameter(200, StorageClass="ConstVolatile", HeaderFile="CEngDsT_DD_Paras.h", DefinitionFile="CEngDsT_DD_Paras.c", DataType="Debncd_ms", Min=0, Max=655, Unit="ms")  % Debounc time for checking heal of DFC_CEngDsTSRCMax
CEngDsT_tiMinDefDeb_C = Simulink.Parameter(200, StorageClass="ConstVolatile", HeaderFile="CEngDsT_DD_Paras.h", DefinitionFile="CEngDsT_DD_Paras.c", DataType="Debncd_ms", Min=0, Max=655, Unit="ms")  % Debounc time for checking heal of DFC_CEngDsTSRCMin
CEngDsT_tiMinOKDeb_C = Simulink.Parameter(200, StorageClass="ConstVolatile", HeaderFile="CEngDsT_DD_Paras.h", DefinitionFile="CEngDsT_DD_Paras.c", DataType="Debncd_ms", Min=0, Max=655, Unit="ms")  % Debounc time for checking heal of DFC_CEngDsTSRCMin
CEngDsT_uSRCMax_C = Simulink.Parameter(5000, StorageClass="ConstVolatile", HeaderFile="CEngDsT_DD_Paras.h", DefinitionFile="CEngDsT_DD_Paras.c", DataType="Volt_mV2", Min=0, Max=5000, Unit="mv")  % Signal Range Check / Threshold for SRC -Max detection
CEngDsT_uSRCMin_C = Simulink.Parameter(200, StorageClass="ConstVolatile", HeaderFile="CEngDsT_DD_Paras.h", DefinitionFile="CEngDsT_DD_Paras.c", DataType="Volt_mV2", Min=0, Max=5000, Unit="mv")  % Signal Range Check / Threshold for SRC -Min detection
CEngDsT_tPhysRngMax_C = Simulink.Parameter(135, StorageClass="ConstVolatile", HeaderFile="CEngDsT_DD_Paras.h", DefinitionFile="CEngDsT_DD_Paras.c", DataType="Temp_C", Min=-50, Max=150, Unit="deg")  % physical range thresholds for Coolant downstream temperature sensor / Maximum threshold for the Sensed value
CEngDsT_tPhysRngMin_C = Simulink.Parameter(-35, StorageClass="ConstVolatile", HeaderFile="CEngDsT_DD_Paras.h", DefinitionFile="CEngDsT_DD_Paras.c", DataType="Temp_C", Min=-50, Max=150, Unit="deg")  % physical range thresholds for Coolant downstream temperature sensor / Minimum threshold for the Sensed value
CEngDsT_tiPhysRngHiDefDeb_C = Simulink.Parameter(200, StorageClass="ConstVolatile", HeaderFile="CEngDsT_DD_Paras.h", DefinitionFile="CEngDsT_DD_Paras.c", DataType="Debncd_ms", Min=0, Max=655, Unit="ms")  % Debounc time for checking heal of DFC_CEngDsTPhysRngHi
CEngDsT_tiPhysRngHiOKDeb_C = Simulink.Parameter(200, StorageClass="ConstVolatile", HeaderFile="CEngDsT_DD_Paras.h", DefinitionFile="CEngDsT_DD_Paras.c", DataType="Debncd_ms", Min=0, Max=655, Unit="ms")  % Debounc time for checking heal of DFC_CEngDsTPhysRngHi
CEngDsT_tiPhysRngLoDefDeb_C = Simulink.Parameter(200, StorageClass="ConstVolatile", HeaderFile="CEngDsT_DD_Paras.h", DefinitionFile="CEngDsT_DD_Paras.c", DataType="Debncd_ms", Min=0, Max=655, Unit="ms")  % Debounc time for checking heal of DFC_CEngDsTPhysRngLo
CEngDsT_tiPhysRngLoOKDeb_C = Simulink.Parameter(200, StorageClass="ConstVolatile", HeaderFile="CEngDsT_DD_Paras.h", DefinitionFile="CEngDsT_DD_Paras.c", DataType="Debncd_ms", Min=0, Max=655, Unit="ms")  % Debounc time for checking heal of DFC_CEngDsTPhysRngLo
CEngDsT_MaxCoolTemp = Simulink.Parameter(150, StorageClass="Const", DataType="Temp_C", Unit="deg")  % Maxmium Coolant Temperature
CEngDsT_MinCoolTemp = Simulink.Parameter(-50, StorageClass="Const", DataType="Temp_C", Unit="deg")  % Minmium Coolant Temperature
CEngDsT_uRaw = Simulink.Signal(StorageClass="ImportedExtern", DataType="Volt_mV2", Min=0, Max=5000, Unit="mv", InitialValue="0")  % Raw ADC value of downstream engine coolant temperature sensor signal
DSM_bCEngDsTSS = Simulink.Signal(StorageClass="ImportedExtern", DataType="boolean", Min=0, Max=1, Unit="NaN", InitialValue="1")  % Status of FId_CEngDsTSS
FM_CEngDsT_SRC_FG_CA = Simulink.Parameter([20 0 0 0 0 0 0 0 0 0], StorageClass="ConstVolatile", HeaderFile="CEngDsT_DD_Paras.h", DefinitionFile="CEngDsT_DD_Paras.c", DataType="Fault_ID", Min=0, Max=65535, Unit="NaN")  % 故障组，元素为故障ID