% Simulink data dictionary EGRVlv_DDSens.sldd
% references slprj_cm.sldd
% references sl_ddtypes.sldd

EGRVlv_rSens = Simulink.Signal(StorageClass="ExportToFile", HeaderFile="EGRVlv_DDSens_Signals.h", DefinitionFile="EGRVlv_DDSens_Signals.c", DataType="DutyCycle", Min=-100, Max=100, Unit="%", InitialValue="0")  % Sensed value of actuator position without error handling
EGRVlv_bFinalDef = Simulink.Signal(StorageClass="ExportToFile", HeaderFile="EGRVlv_DDSens_Signals.h", DefinitionFile="EGRVlv_DDSens_Signals.c", DataType="boolean", Min=0, Max=1, Unit="NaN", InitialValue="0")  % the final fault flag
EGRVlv_bProvDef = Simulink.Signal(StorageClass="ExportToFile", HeaderFile="EGRVlv_DDSens_Signals.h", DefinitionFile="EGRVlv_DDSens_Signals.c", DataType="boolean", Min=0, Max=1, Unit="NaN", InitialValue="0")  % the fault flag for the moment
EGRVlv_bSRCMaxDeb_DSM = Simulink.Signal(StorageClass="ExportToFile", HeaderFile="EGRVlv_DDSens_Signals.h", DefinitionFile="EGRVlv_DDSens_Signals.c", DataType="boolean", Min=0, Max=1, Unit="NaN", InitialValue="0")  % SRC High for EGR position sensor voltage
EGRVlv_bSRCMinDeb_DSM = Simulink.Signal(StorageClass="ExportToFile", HeaderFile="EGRVlv_DDSens_Signals.h", DefinitionFile="EGRVlv_DDSens_Signals.c", DataType="boolean", Min=0, Max=1, Unit="NaN", InitialValue="0")  % SRC Low for EGR position sensor voltage
EGRVlv_bPhysRngHiDeb_DSM = Simulink.Signal(StorageClass="ExportToFile", HeaderFile="EGRVlv_DDSens_Signals.h", DefinitionFile="EGRVlv_DDSens_Signals.c", DataType="boolean", Min=0, Max=1, Unit="NaN", InitialValue="0")  % Status of EGRVlv_bPhysRngHiDeb
EGRVlv_bPhysRngLoDeb_DSM = Simulink.Signal(StorageClass="ExportToFile", HeaderFile="EGRVlv_DDSens_Signals.h", DefinitionFile="EGRVlv_DDSens_Signals.c", DataType="boolean", Min=0, Max=1, Unit="NaN", InitialValue="0")  % Status of EGRVlv_bPhysRngLoDeb
EGRVlv_bPhysRngFinalDef = Simulink.Signal(StorageClass="ExportToFile", HeaderFile="EGRVlv_DDSens_Signals.h", DefinitionFile="EGRVlv_DDSens_Signals.c", DataType="boolean", Min=0, Max=1, Unit="NaN", InitialValue="0")  % Status Sensor of the EGR valve physical Signal range check finally defect
EGRVlv_bPhysRngProvDef = Simulink.Signal(StorageClass="ExportToFile", HeaderFile="EGRVlv_DDSens_Signals.h", DefinitionFile="EGRVlv_DDSens_Signals.c", DataType="boolean", Min=0, Max=1, Unit="NaN", InitialValue="0")  % Status Sensor of the EGR valve physical Signal range check temporary defect
EGRVlv_bSRCMax = Simulink.Signal(StorageClass="ExportToFile", HeaderFile="EGRVlv_DDSens_Signals.h", DefinitionFile="EGRVlv_DDSens_Signals.c", DataType="boolean", Min=0, Max=1, Unit="NaN", InitialValue="0")  % EGR Valve voltage signal maximum limit value
EGRVlv_bSRCMin = Simulink.Signal(StorageClass="ExportToFile", HeaderFile="EGRVlv_DDSens_Signals.h", DefinitionFile="EGRVlv_DDSens_Signals.c", DataType="boolean", Min=0, Max=1, Unit="NaN", InitialValue="0")  % EGR Valve voltage signal minimum limit value
EGRVlv_bPhysRngHi = Simulink.Signal(StorageClass="ExportToFile", HeaderFile="EGRVlv_DDSens_Signals.h", DefinitionFile="EGRVlv_DDSens_Signals.c", DataType="boolean", Min=0, Max=1, Unit="NaN", InitialValue="0")  % Status Sensor of the EGR Valve high voltage Signal range
EGRVlv_bPhysRngLo = Simulink.Signal(StorageClass="ExportToFile", HeaderFile="EGRVlv_DDSens_Signals.h", DefinitionFile="EGRVlv_DDSens_Signals.c", DataType="boolean", Min=0, Max=1, Unit="NaN", InitialValue="0")  % Status Sensor of the EGR Valve low voltage Signal range
EGRVlv_rTransf_CURX = Simulink.Parameter([331 408 458 507 629 787 882 977 1220 1518 1691 1865 2273 2700 3142 3363 3571 3956 4115 4274 4518 4696 4755 4815 4892], StorageClass="ExportToFile", HeaderFile="EGRVlv_DDSens_Paras.h", DefinitionFile="EGRVlv_DDSens_Paras.c", DataType="Volt_mV", Min=0, Max=5000, Unit="mv")  % Transformation aixs to convert the voltage value to positon value
EGRVlv_rTransf_CUR = Simulink.Parameter([98 95 92 90 85 80 75 70 65 60 50 45 40 36 30 28 26 21 17 15 13 10 8 6 2], StorageClass="ExportToFile", HeaderFile="EGRVlv_DDSens_Paras.h", DefinitionFile="EGRVlv_DDSens_Paras.c", DataType="DutyCycle", Min=-100, Max=100, Unit="%")  % Transformation curve to convert the voltage value to positon value
EGRVlv_tiMaxDefDeb_C = Simulink.Parameter(200, StorageClass="ExportToFile", HeaderFile="EGRVlv_DDSens_Paras.h", DefinitionFile="EGRVlv_DDSens_Paras.c", DataType="Debncd_ms", Min=0, Max=6553.5, Unit="ms")  % Debounce time for checking heal of EGRVlv_bSRCMaxDeb
EGRVlv_tiMaxOKDeb_C = Simulink.Parameter(200, StorageClass="ExportToFile", HeaderFile="EGRVlv_DDSens_Paras.h", DefinitionFile="EGRVlv_DDSens_Paras.c", DataType="Debncd_ms", Min=0, Max=6553.5, Unit="ms")  % Debounce time for checking heal of EGRVlv_bSRCMaxDeb
EGRVlv_tiMinDefDeb_C = Simulink.Parameter(200, StorageClass="ExportToFile", HeaderFile="EGRVlv_DDSens_Paras.h", DefinitionFile="EGRVlv_DDSens_Paras.c", DataType="Debncd_ms", Min=0, Max=6553.5, Unit="ms")  % Debounce time for checking heal of EGRVlv_bSRCMinDeb
EGRVlv_tiMinOKDeb_C = Simulink.Parameter(200, StorageClass="ExportToFile", HeaderFile="EGRVlv_DDSens_Paras.h", DefinitionFile="EGRVlv_DDSens_Paras.c", DataType="Debncd_ms", Min=0, Max=6553.5, Unit="ms")  % Debounce time for checking heal of EGRVlv_bSRCMinDeb
EGRVlv_uSRCMax_C = Simulink.Parameter(4800, StorageClass="ExportToFile", HeaderFile="EGRVlv_DDSens_Paras.h", DefinitionFile="EGRVlv_DDSens_Paras.c", DataType="Volt_mV", Min=0, Max=5000, Unit="mv")  % Class for default values for signal range check analog input / Threshold for SRC -Max detection
EGRVlv_uSRCMin_C = Simulink.Parameter(200, StorageClass="ExportToFile", HeaderFile="EGRVlv_DDSens_Paras.h", DefinitionFile="EGRVlv_DDSens_Paras.c", DataType="Volt_mV", Min=0, Max=5000, Unit="mv")  % Class for default values for signal range check analog input / Threshold for SRC -Min detection
EGRVlv_tiPhysRngHiDefDeb_C = Simulink.Parameter(200, StorageClass="ExportToFile", HeaderFile="EGRVlv_DDSens_Paras.h", DefinitionFile="EGRVlv_DDSens_Paras.c", DataType="Debncd_ms", Min=0, Max=6553.5, Unit="ms")  % Debounce time for checking heal of EGRVlv_bPhysRngHiDeb
EGRVlv_tiPhysRngHiOKDeb_C = Simulink.Parameter(200, StorageClass="ExportToFile", HeaderFile="EGRVlv_DDSens_Paras.h", DefinitionFile="EGRVlv_DDSens_Paras.c", DataType="Debncd_ms", Min=0, Max=6553.5, Unit="ms")  % Debounce time for checking heal of EGRVlv_bPhysRngHiDeb
EGRVlv_tiPhysRngLoDefDeb_C = Simulink.Parameter(200, StorageClass="ExportToFile", HeaderFile="EGRVlv_DDSens_Paras.h", DefinitionFile="EGRVlv_DDSens_Paras.c", DataType="Debncd_ms", Min=0, Max=6553.5, Unit="ms")  % Debounce time for checking heal of EGRVlv_bPhysRngLoDeb
EGRVlv_tiPhysRngLoOKDeb_C = Simulink.Parameter(200, StorageClass="ExportToFile", HeaderFile="EGRVlv_DDSens_Paras.h", DefinitionFile="EGRVlv_DDSens_Paras.c", DataType="Debncd_ms", Min=0, Max=6553.5, Unit="ms")  % Debounce time for checking heal of EGRVlv_bPhysRngLoDeb
EGRVlv_rAdapDiffPlausLgT_C = Simulink.Parameter(20, StorageClass="ExportToFile", HeaderFile="EGRVlv_DDSens_Paras.h", DefinitionFile="EGRVlv_DDSens_Paras.c", DataType="DutyCycle", Min=-100, Max=100, Unit="%")  % Long time drift threshold