% Simulink data dictionary InjCtl_qCo.sldd
% references slprj_cm.sldd
% references sl_ddtypes.sldd
% references sl_const.sldd
% references slprj_FM.sldd

InjCtl_qSetUnBal = Simulink.Signal(StorageClass="ExportedGlobal", DataType="InjMass", Min=-319, Max=319, Unit="mg/hub", InitialValue="0")  % Torque generating engine fuel injection quantity
InjCtl_qRaw = Simulink.Signal(StorageClass="ExportedGlobal", DataType="InjMass", Min=-319, Max=319, Unit="mg/hub", InitialValue="0")  % Raw value of injection mass
InjCtl_dqLead = Simulink.Signal(StorageClass="ExportedGlobal", DataType="InjMass", Min=-319, Max=319, Unit="mg/hub", InitialValue="0")  % Gradient of quantity
InjCtl_swtDiffQntIn_C = Simulink.Parameter(Switch.OFF, StorageClass="ConstVolatile", HeaderFile="InjCtl_qCo_Paras.h", DefinitionFile="InjCtl_qCo_Paras.c", DataType="Enum: Switch", Unit="NaN")  % Selection of input quantity
FMA_qCor_C = Simulink.Parameter(0, StorageClass="ConstVolatile", HeaderFile="InjCtl_qCo_Paras.h", DefinitionFile="InjCtl_qCo_Paras.c", DataType="InjMass", Min=-319, Max=319, Unit="mg/hub")  % Correction quantity of FMA (indirect control)
FMO_qCor_C = Simulink.Parameter(0, StorageClass="ConstVolatile", HeaderFile="InjCtl_qCo_Paras.h", DefinitionFile="InjCtl_qCo_Paras.c", DataType="InjMass", Min=-319, Max=319, Unit="mg/hub")  % Correction quantity of FMO