% Simulink data dictionary RailP_DD.sldd
% references slprj_cm.sldd
% references sl_ddtypes.sldd
% references sl_const.sldd
% references slprj_FM.sldd

RailP_pLin = Simulink.Signal(StorageClass="ExportedGlobal", DataType="Press_bar1", Min=0, Max=2000, Unit="bar", InitialValue="0")  % Fuel pressure
RailP_bFinalDef = Simulink.Signal(StorageClass="ExportedGlobal", DataType="boolean", Min=0, Max=1, Unit="NaN", InitialValue="0")  % Status of final default
RailP_bProvDef = Simulink.Signal(StorageClass="ExportedGlobal", DataType="boolean", Min=0, Max=1, Unit="NaN", InitialValue="0")  % Status of provisional default
RailP_bSRCMaxDeb_DSM = Simulink.Signal(StorageClass="ExportedGlobal", DataType="boolean", Min=0, Max=1, Unit="NaN", InitialValue="0")  % The debounce result of SRC
RailP_bSRCMinDeb_DSM = Simulink.Signal(StorageClass="ExportedGlobal", DataType="boolean", Min=0, Max=1, Unit="NaN", InitialValue="0")  % The debounce result of SRC
RailP_bSRCMax = Simulink.Signal(StorageClass="ExportedGlobal", DataType="boolean", Min=0, Max=1, Unit="NaN", InitialValue="0")  % The result of the signal range check
RailP_bSRCMin = Simulink.Signal(StorageClass="ExportedGlobal", DataType="boolean", Min=0, Max=1, Unit="NaN", InitialValue="0")  % The result of the signal range check
RailP_pLin_base = Simulink.Signal(StorageClass="ExportedGlobal", DataType="Press_bar1", Min=0, Max=2000, Unit="bar", InitialValue="0")  % Fuel pressure from curve
RailP_uSRCMax_C = Simulink.Parameter(4700, StorageClass="ConstVolatile", HeaderFile="RailP_DD_Paras.h", DefinitionFile="RailP_DD_Paras.c", DataType="Volt_mV1", Min=0, Max=5000, Unit="mv")  % Threshold for SRC -Max detection
RailP_uSRCMin_C = Simulink.Parameter(131, StorageClass="ConstVolatile", HeaderFile="RailP_DD_Paras.h", DefinitionFile="RailP_DD_Paras.c", DataType="Volt_mV1", Min=0, Max=5000, Unit="mv")  % Threshold for SRC -Min detection
RailP_pLin_CUR = Simulink.Parameter([0 0 0 2000], StorageClass="ConstVolatile", HeaderFile="RailP_DD_Paras.h", DefinitionFile="RailP_DD_Paras.c", DataType="Press_bar1", Min=0, Max=2000, Unit="bar")  % Linearisation curve for fuel pressure sensor
RailP_pLin_CURX = Simulink.Parameter([0 500 1006 4501], StorageClass="ConstVolatile", HeaderFile="RailP_DD_Paras.h", DefinitionFile="RailP_DD_Paras.c", DataType="Volt_mV1", Min=0, Max=5000, Unit="mv")  % RailP_uRaw
RailP_tiSRCMaxDefDeb_C = Simulink.Parameter(200, StorageClass="ConstVolatile", HeaderFile="RailP_DD_Paras.h", DefinitionFile="RailP_DD_Paras.c", DataType="Debncd_ms", Min=0, Max=1000, Unit="ms")  % Debounce time for checking defect of RailP_bSRCMaxDeb
RailP_tiSRCMaxOKDeb_C = Simulink.Parameter(200, StorageClass="ConstVolatile", HeaderFile="RailP_DD_Paras.h", DefinitionFile="RailP_DD_Paras.c", DataType="Debncd_ms", Min=0, Max=1000, Unit="ms")  % Debounce time for checking heal of RailP_bSRCMaxDeb
RailP_tiSRCMinDefDeb_C = Simulink.Parameter(200, StorageClass="ConstVolatile", HeaderFile="RailP_DD_Paras.h", DefinitionFile="RailP_DD_Paras.c", DataType="Debncd_ms", Min=0, Max=1000, Unit="ms")  % Debounce time for checking defect of RailP_bSRCMinDeb
RailP_tiSRCMinOKDeb_C = Simulink.Parameter(200, StorageClass="ConstVolatile", HeaderFile="RailP_DD_Paras.h", DefinitionFile="RailP_DD_Paras.c", DataType="Debncd_ms", Min=0, Max=1000, Unit="ms")  % Debounce time for checking heal of RailP_bSRCMinDeb