% Simulink data dictionary APP_DD2.sldd
% references slprj_cm.sldd
% references sl_ddtypes.sldd
% references sl_const.sldd
% references slprj_FM.sldd

APP_uRaw2 = Simulink.Signal(StorageClass="ExportedGlobal", DataType="Volt_mV1", Min=0, Max=5000, Unit="mv", InitialValue="0")  % Acceleration Pedal Position E
APP_bAPP2FinalDef = Simulink.Signal(StorageClass="ExportedGlobal", DataType="boolean", Min=0, Max=1, Unit="NaN", InitialValue="0")  % Status Sensor 2 of the acceleration pedal finally defect
APP_bAPP2ProvDef = Simulink.Signal(StorageClass="ExportedGlobal", DataType="boolean", Min=0, Max=1, Unit="NaN", InitialValue="0")  % Status Sensor 2 of the acceleration pedal temporary defect
APP_bSRCHigh2Deb_DSM = Simulink.Signal(StorageClass="ExportedGlobal", DataType="boolean", Min=0, Max=1, Unit="NaN", InitialValue="0")  % Status debounced SRC-High error Sensor 2
APP_bSRCLow2Deb_DSM = Simulink.Signal(StorageClass="ExportedGlobal", DataType="boolean", Min=0, Max=1, Unit="NaN", InitialValue="0")  % Status debounced SRC-Low error Sensor 2
APP_bSRCHigh2 = Simulink.Signal(StorageClass="ExportedGlobal", DataType="boolean", Min=0, Max=1, Unit="NaN", InitialValue="0")  % Status temporary SRC-High error Sensor 2
APP_bSRCLow2 = Simulink.Signal(StorageClass="ExportedGlobal", DataType="boolean", Min=0, Max=1, Unit="NaN", InitialValue="0")  % Status temporary SRC-Low error Sensor 2
APP_uRaw2SRCHigh_C = Simulink.Parameter(5000, StorageClass="ConstVolatile", HeaderFile="APP_DD2_Paras.h", DefinitionFile="APP_DD2_Paras.c", DataType="Volt_mV1", Min=0, Max=5000, Unit="mv")  % voltage upper threshold of channel 2
APP_uRaw2SRCLow_C = Simulink.Parameter(500, StorageClass="ConstVolatile", HeaderFile="APP_DD2_Paras.h", DefinitionFile="APP_DD2_Paras.c", DataType="Volt_mV1", Min=0, Max=5000, Unit="mv")  % voltage lower threshold of channel 2
APP_tiSRCHighDefDeb2_C = Simulink.Parameter(100, StorageClass="ConstVolatile", HeaderFile="APP_DD2_Paras.h", DefinitionFile="APP_DD2_Paras.c", DataType="Debncd_ms", Min=0, Max=1000, Unit="ms")  % debounce time
APP_tiSRCHighOKDeb2_C = Simulink.Parameter(100, StorageClass="ConstVolatile", HeaderFile="APP_DD2_Paras.h", DefinitionFile="APP_DD2_Paras.c", DataType="Debncd_ms", Min=0, Max=1000, Unit="ms")  % debounce time
APP_tiSRCLowDefDeb2_C = Simulink.Parameter(100, StorageClass="ConstVolatile", HeaderFile="APP_DD2_Paras.h", DefinitionFile="APP_DD2_Paras.c", DataType="Debncd_ms", Min=0, Max=1000, Unit="ms")  % debounce time
APP_tiSRCLowOKDeb2_C = Simulink.Parameter(100, StorageClass="ConstVolatile", HeaderFile="APP_DD2_Paras.h", DefinitionFile="APP_DD2_Paras.c", DataType="Debncd_ms", Min=0, Max=1000, Unit="ms")  % debounce time
APP_uRaw2Def_C = Simulink.Parameter(0, StorageClass="ConstVolatile", HeaderFile="APP_DD2_Paras.h", DefinitionFile="APP_DD2_Paras.c", DataType="Volt_mV1", Min=0, Max=5000, Unit="mv")  % Substitute value for sensor 2 defect
FM_APP2_SRC_FG_CA = Simulink.Parameter(repmat(0, 1, 15), StorageClass="ConstVolatile", HeaderFile="APP_DD2_Paras.h", DefinitionFile="APP_DD2_Paras.c", DataType="Fault_ID", Min=0, Max=65535, Unit="NaN")  % Fault Group