% Simulink data dictionary APP_SelSig.sldd
% references slprj_cm.sldd
% references sl_ddtypes.sldd
% references sl_const.sldd
% references slprj_FM.sldd

APP_uRaw_mp = Simulink.Signal(StorageClass="ExportedGlobal", DataType="Volt_mV1", Min=0, Max=5000, Unit="mv", InitialValue="0")  % Acceleration pedal position raw value
APP_stSigSrc_APPLIMP_BP = Simulink.Signal(StorageClass="ExportedGlobal", DataType="boolean", Min=0, Max=1, Unit="NaN", InitialValue="0")  % Substitute operation active, accelerator pedal sensor value and accelerator pedal sensor increase are limited
APP_stSigSrc_APPDEF_BP = Simulink.Signal(StorageClass="ExportedGlobal", DataType="boolean", Min=0, Max=1, Unit="NaN", InitialValue="0")  % both the sensors are defective. Use the default value
APP_stSigSrc_APP1_BP = Simulink.Signal(StorageClass="ExportedGlobal", DataType="boolean", Min=0, Max=1, Unit="NaN", InitialValue="0")  % Sensor 1 is the reference variable, Sensor 2 value is defective
APP_stSigSrc_APP2_BP = Simulink.Signal(StorageClass="ExportedGlobal", DataType="boolean", Min=0, Max=1, Unit="NaN", InitialValue="0")  % Sensor 2 is the reference variable,Sensor1 value is defective
APP_stTempErr_mp = Simulink.Signal(StorageClass="ExportedGlobal", DataType="boolean", Min=0, Max=1, Unit="NaN", InitialValue="0")  % Status for temporary errors
APP_uRaw2Offset_C = Simulink.Parameter(0, StorageClass="ConstVolatile", HeaderFile="APP_SelSig_Paras.h", DefinitionFile="APP_SelSig_Paras.c", DataType="Volt_mV1", Min=0, Max=5000, Unit="mv")  % Offset for sensor signal 2
APP_uAPPDef_C = Simulink.Parameter(0, StorageClass="ConstVolatile", HeaderFile="APP_SelSig_Paras.h", DefinitionFile="APP_SelSig_Paras.c", DataType="Volt_mV1", Min=0, Max=5000, Unit="mv")  % Substitute value if both sensors are defect
APP_duLimErrPos_C = Simulink.Parameter(1000, StorageClass="ConstVolatile", HeaderFile="APP_SelSig_Paras.h", DefinitionFile="APP_SelSig_Paras.c", DataType="Volt_mV_s2", Min=0, Max=5000, Unit="mv/s")  % error ramp within the selction of mastersignal /positive ramp slope
MoFAPP_dRawSigFac_C = Simulink.Parameter(2, StorageClass="ConstVolatile", HeaderFile="APP_SelSig_Paras.h", DefinitionFile="APP_SelSig_Paras.c", DataType="Fac10", Min=0, Max=8, Unit="NaN")  % Factor between the voltage of APP1 and APP2