% Simulink data dictionary T15_DD.sldd
% references slprj_cm.sldd
% references sl_ddtypes.sldd
% references sl_const.sldd
% references slprj_FM.sldd

T15_st = Simulink.Signal(StorageClass="ExportedGlobal", DataType="Enum:Switch", Unit="NaN", InitialValue="Switch.OFF")  % Terminal 15 status after debouncing
T15_stRaw = Simulink.Signal(StorageClass="ExportedGlobal", DataType="boolean", Unit="NaN", InitialValue="0")  % Raw value of Terminal 15 status
T15_tiDebLoHi_C = Simulink.Parameter(10, StorageClass="ConstVolatile", HeaderFile="T15_DD_Paras.h", DefinitionFile="T15_DD_Paras.c", DataType="Debncd_ms", Min=0, Max=1000, Unit="ms")  % Debounce time terminal15-signal from high to low
T15_tiDebHiLo_C = Simulink.Parameter(10, StorageClass="ConstVolatile", HeaderFile="T15_DD_Paras.h", DefinitionFile="T15_DD_Paras.c", DataType="Debncd_ms", Min=0, Max=1000, Unit="ms")  % Debounce time terminal15-signal from low to high
T15_uThreshold_C = Simulink.Parameter(800, StorageClass="ConstVolatile", HeaderFile="T15_DD_Paras.h", DefinitionFile="T15_DD_Paras.c", DataType="Volt_mV1", Min=0, Max=5000, Unit="mv")  % T15 voltage threshold